# Grasshopper definition boxes.gh (Grasshopper 0.9.76)
# plug-ins: Biomorpher

number_slider = Slider(3.27480769, range=0..10)
number_slider_2 = Slider(8.70158727, range=0..10)
number_slider_3 = Slider(7.69108691, range=0..10)
number_slider_4 = Slider(3.6106928, range=0..10)
number_slider_5 = Slider(3.68866533, range=0..10)
number_slider_6 = Slider(5.0588844, range=0..10)
number_slider_7 = Slider(4.70017559, range=0..10)
number_slider_8 = Slider(9.51768065, range=0..10)
number_slider_9 = Slider(1.89639171, range=0..10)
number_slider_10 = Slider(4.6635888, range=0..10)
number_slider_11 = Slider(7.60935747, range=0..10)
number_slider_12 = Slider(3.55960268, range=0..10)
number_slider_13 = Slider(2.44898361, range=0..10)
number_slider_14 = Slider(3.87250115, range=0..10)
number_slider_15 = Slider(2.71865761, range=0..10)
number_slider_16 = Slider(9.36780721, range=0..10)
number_slider_17 = Slider(7.17587463, range=0..10)
number_slider_18 = Slider(6.30764688, range=0..10)
dom = ConstructDomain(DomainStart=number_slider, DomainEnd=number_slider_2)
dom_2 = ConstructDomain(DomainStart=number_slider_3, DomainEnd=number_slider_4)
dom_3 = ConstructDomain(DomainStart=number_slider_5, DomainEnd=number_slider_6)
dom_4 = ConstructDomain(DomainStart=number_slider_7, DomainEnd=number_slider_8)
dom_5 = ConstructDomain(DomainStart=number_slider_12, DomainEnd=number_slider_9)
dom_6 = ConstructDomain(DomainStart=number_slider_13, DomainEnd=number_slider_10)
dom_7 = ConstructDomain(DomainStart=number_slider_11, DomainEnd=number_slider_14)
dom_8 = ConstructDomain(DomainStart=number_slider_15, DomainEnd=number_slider_16)
dom_9 = ConstructDomain(DomainStart=number_slider_17, DomainEnd=number_slider_18)
dom_10 = ConstructDomain(DomainStart=Slider(3, range=0..10), DomainEnd=Slider(7, range=0..10))
box = DomainBox(Base=PlaneXY(0, 0, 0), X=dom_10, Y=dom_10, Z=dom_10)
box_2 = DomainBox(Base=PlaneXY(0, 0, 0), X=dom, Y=dom_2, Z=dom_3)
box_3 = DomainBox(Base=PlaneXY(0, 0, 0), X=dom_4, Y=dom_5, Z=dom_6)
box_4 = DomainBox(Base=PlaneXY(0, 0, 0), X=dom_7, Y=dom_8, Z=dom_9)
sdiff = SolidDifference(BrepsA=box, BrepsB=[box_2, box_4, box_3])
mesh = Mesh(sdiff)
biomorpher = Biomorpher(
    Genome=[number_slider_18, number_slider_17, number_slider_16, number_slider_15, number_slider_14, number_slider_11, number_slider_6, number_slider_5, number_slider_4, number_slider_3, number_slider_2, number_slider, number_slider_7, number_slider_8, number_slider_12, number_slider_9, number_slider_13, number_slider_10],
    Geometry=mesh)
