# Grasshopper definition genepools.gh (Grasshopper 0.9.76)
# plug-ins: Biomorpher

genes = GenePool(
    Decimals=2,
    Maximum=100,
    Minimum=0,
    Value=[83.05958194, 85.68847497, 69.37224837, 67.19339652, 46.61636019, 99.92208111, 39.04048387, 76.84805417, 87.76966584, 69.86255534])
genes_2 = GenePool(
    Decimals=2,
    Maximum=100,
    Minimum=0,
    Value=[58.1947693, 99.45784325, 95.06902182, 92.44317185, 85.35670554, 45.19814345, 26.59200877, 51.35411407, 33.85879907, 38.21438699])
pt = ConstructPoint(XCoordinate=genes_2, YCoordinate=genes, ZCoordinate=0)
msphereex = MeshSphereEx(Base=pt, Radius=10, Count=5)
biomorpher = Biomorpher(Genome=[genes_2, genes], Geometry=msphereex)
