# Grasshopper definition mobius.gh (Grasshopper 0.9.76)
# plug-ins: Biomorpher, MeshEdit Components, LunchBox, Weaverbird

number_slider = Slider(4, range=0..5)
number_slider_2 = Slider(6, range=2..10)
number_slider_3 = Slider(63, range=29..100)
mobius = MobiusSurface(
    UDivisions=100,
    VDivisions=100,
    RParameter=4,
    TParameter=number_slider,
    Scale=5,
    Domain1=Domain(-3.141592654, 3.141592654),
    Domain2=Domain(-1, 1))
number_slider_4 = Slider(0.8022, range=0..1)
number_slider_5 = Slider(0.2092, range=0..1)
number_slider_6 = Slider(0.1419, range=0..1)
hex = HexagonCells(Surface=mobius, UDivisions=number_slider_3, VDivisions=number_slider_2, TParameter=0.25)  # -> HexagonCells, Centers
wbframe = WeaverbirdsPictureFrame(MeshPolylines=hex.HexagonCells, Distance=5, InsetType=0)
wbthicken = WeaverbirdsMeshThicken(MeshCurves=wbframe, Distance=Slider(2.9, range=0..10), OffsetType=0)
panel = Panel("red")
frgb = ColourRGBF(Alpha=1, Red=number_slider_4, Green=number_slider_5, Blue=number_slider_6)
mcol = MeshColours(Mesh=wbthicken, Colours=frgb)
demesh = DeconstructMesh(Mesh=mcol)  # -> Vertices, Faces, Colours, Normals
area = MeshArea(Mesh=mcol)  # -> Area, Centroid
lng = ListLength(List=demesh.Vertices)
lng_2 = ListLength(List=demesh.Faces)
biomorpher = Biomorpher(
    Genome=[number_slider_2, number_slider_3, number_slider, number_slider_4, number_slider_5, number_slider_6],
    Geometry=mcol,
    Performance=[lng, lng_2, area.Area])
item = ListItem(List=biomorpher, Index=0, Wrap=True)  # -> Item, Item1, Item2
pt = ConstructPoint(XCoordinate=item.Item, YCoordinate=item.Item1, ZCoordinate=item.Item2)

# ---- group: Cluster no.
cluster = Slider(0, range=0..12)

# ----
panel_2 = Panel(biomorpher)
pshift = ShiftPaths(Data=pt, Offset=-1)
branch = TreeBranch(Tree=pshift, Path=cluster, MaintainPaths=True)
tstat = TreeStatistics(Tree=pshift)  # -> Paths, Length, Count
range = Range(Domain=Domain(0, 1), Steps=expr("X-1", tstat.Count))
gradient = Gradient(
    LowerLimit=0,
    UpperLimit=1,
    Parameter=range,
    stops=[0: RGB(243, 57, 0), 0.1: RGB(236, 27, 60), 0.2: RGB(210, 0, 118), 0.3: RGB(103, 0, 120), 0.4: RGB(39, 72, 161), 0.5: RGB(1, 192, 229), 0.6: RGB(18, 178, 90), 0.7: RGB(79, 186, 8), 0.8: RGB(220, 237, 32), 0.9: RGB(247, 159, 20), 1: RGB(243, 57, 0)])
col = Colour(graft(gradient))
dots = DotDisplay(Point=pshift, Colour=col, Size=Slider(0.02, range=0..0.1))
