# Grasshopper definition 03 Vases.gh (Grasshopper 1.0.7)
# plug-ins: Biomorpher

genes = GenePool(
    Decimals=2,
    Maximum=2,
    Minimum=0.05,
    Value=[1.829442841, 0.5476804053, 1.91133243, 1.076003266, 1.237771434, 0.7334188584])
pt = ConstructPoint(XCoordinate=0, YCoordinate=0, ZCoordinate=0)
Z = UnitZ(Factor=1)
line = LineSDL(Start=pt, Direction=Z, Length="10")
number_slider = Slider(14, range=3..20)
pframes = PerpFrames(Curve=line, Count=Slider(6, range=0..10), Align=True)  # -> Frames, Parameters
polygon = Polygon(Plane=pframes.Frames, Radius=genes, Segments=number_slider, FilletRadius=0)  # -> Polygon, Length
loft = Loft(Curves=polygon.Polygon, Options={Adjust=False, Closed=False, LoftEnds=0, LoftSimp=0, LoftType=0, Rebuild=10, Refit=0.01})
debrep = DeconstructBrep(Brep=loft)  # -> Faces, Edges, Vertices
area = Area(Geometry=loft)  # -> SurfaceArea, Centroid
variance = Variance(num=genes)
mesh_uv = MeshSurface(Surface=debrep.Faces, UCount="20", VCount="4", Overhang=True, Equalize=False)
biomorpher = Biomorpher(Genome=[genes, number_slider], Geometry=mesh_uv, Performs=[area.SurfaceArea, variance])

# ==== cluster Variance: Variance
num = ClusterInput()
num_2 = Number(num)
avr = Average(Input=num_2)
subtraction = Subtraction(A=avr, B=num_2)
lng = ListLength(List=num_2)
sqr = Square(Value=subtraction)
ma = MassAddition(Input=sqr)  # -> Result, PartialResults
division = Division(A=ma.Result, B=lng)
R = ClusterOutput(division)
