# Grasshopper definition BooleanBoxes.gh (Grasshopper 0.9.76)
# plug-ins: Biomorpher, MeshEdit Components

genes = GenePool(
    Decimals=2,
    Maximum=10,
    Minimum=0,
    Value=[5.509457675, 6.588410026, 4.226552753, 0.2113413532, 8.538852035, 2.661791194, 7.763329436, 2.479239932, 8.519919812, 3.93162341])
genes_2 = GenePool(
    Decimals=2,
    Maximum=10,
    Minimum=0,
    Value=[0.1319208835, 8.617738173, 0.7287928791, 2.085942948, 6.759717565, 7.712955171, 9.090697933, 5.818591391, 7.633530306, 0.7975768208])
genes_3 = GenePool(
    Decimals=2,
    Maximum=10,
    Minimum=0,
    Value=[3.047377254, 6.958679649, 3.090044718, 4.816941882, 1.814071835, 2.485770994, 9.892905275, 3.510350889, 3.584481451, 5.976946506])
genes_4 = GenePool(
    Decimals=2,
    Maximum=10,
    Minimum=0,
    Value=[3.84490472, 2.454183806, 3.14078781, 9.190873419, 7.425930769, 3.362296132, 7.427628272, 4.692458578, 7.585586676, 5.852830646])
genes_5 = GenePool(
    Decimals=2,
    Maximum=10,
    Minimum=0,
    Value=[9.858321743, 9.298264393, 1.933014296, 0.01574376599, 1.218526923, 1.163340379, 3.240966985, 2.277136381, 0.06896827373, 4.228376096])
genes_6 = GenePool(
    Decimals=2,
    Maximum=10,
    Minimum=0,
    Value=[8.911250843, 4.069794013, 5.056762381, 7.617195089, 1.437755419, 8.550778026, 3.498365308, 9.409610871, 8.397269518, 6.053081041])
dom = ConstructDomain(DomainStart=genes_5, DomainEnd=genes_6)
dom_2 = ConstructDomain(DomainStart=genes_3, DomainEnd=genes_4)
dom_3 = ConstructDomain(DomainStart=genes, DomainEnd=genes_2)
box = DomainBox(Base=PlaneXY(0, 0, 0), X=dom_3, Y=dom_2, Z=dom)
bbox = BoundingBox(Content=box, Plane=PlaneXY(0, 0, 0), UnionBox=True)  # -> Box, Box_2
volume = Volume(Geometry=bbox.Box)  # -> Volume, Centroid
scale = Scale(Geometry=bbox.Box, Center=volume.Centroid, Factor="0.9")  # -> Geometry, Transform
number_slider = Slider(114, range=0..254)
number_slider_2 = Slider(214, range=0..254)
number_slider_3 = Slider(68, range=0..254)
sdiff = SolidDifference(BrepsA=scale.Geometry, BrepsB=box)
rgb = ColourRGB(Alpha=255, Red=number_slider, Green=number_slider_2, Blue=number_slider_3)
mesh = MeshBrep(
    Brep=sdiff,
    Settings={GridMaxCount=0, GridMinCount=16, JaggedSeams=False, MaxEdgeLength=0, MinEdgeLength=0.0001, MinTolerance=0, Refine=True, RefineAngle=0, RelativeTolerance=0.65, SimplePlanes=True, Tolerance=0})
mjoin = MeshJoin(Meshes=mesh)
mcol = MeshColours(Mesh=mjoin, Colours=rgb)
volume_2 = MeshVolume(Mesh=mcol)  # -> Volume, Centroid
biomorpher = Biomorpher(
    Genome=[number_slider_3, number_slider_2, number_slider, genes, genes_2, genes_3, genes_4, genes_5, genes_6],
    MeshEs=mcol,
    Performance=volume_2.Volume)  # -> GenoGuids, Population, Historic, Clusters

# ---- group: Visualise Cluster Distribution
viewer = ParamViewer(biomorpher.Clusters)

# ---- group: Internalise these to store data
id = Guid()
num = Number()
num_2 = Number()

# ---- group: Biomorpher Reader component
biomorpherreader = BiomorpherReader(DesignID=Slider(38, range=0..99))
