# Grasshopper definition QuadtreeExtrusions.gh (Grasshopper 0.9.76)
# plug-ins: Biomorpher

genes = GenePool(
    Decimals=2,
    Maximum=100,
    Minimum=0,
    Value=[8.406259157, 15.4943046, 91.46300036, 56.40864713, 84.26863586, 93.37938245, 66.82503949, 12.84061582, 74.19321611, 68.63088062, 31.40723099, 5.170479294, 51.15243162, 86.86312958, 36.88137447, 31.81037514, 30.34470252, 79.22687298, 96.20394752, 59.75098249])
genes_2 = GenePool(
    Decimals=2,
    Maximum=20,
    Minimum=0,
    Value=[1.172974124, 14.18551033, 18.97014099, 11.27015742, 15.38935583, 1.592453633, 15.58253027, 5.429679259, 10.87743438, 9.848037353, 14.56931233, 8.584790457, 4.156736128, 2.371991791, 12.18046835, 18.28699068, 15.75110319, 17.5649672, 12.79665619, 14.96032886])
# In this example, genepools are used to
# create planar curves that are then extruded.
# Double click on the biomorpher component to begin.
genes_3 = GenePool(
    Decimals=2,
    Maximum=100,
    Minimum=0,
    Value=[61.377162, 35.01177152, 47.25141565, 12.23821492, 14.03959473, 86.97969871, 83.89618843, 65.04999775, 17.24519069, 87.41557933, 72.70342064, 80.18249002, 18.3866527, 96.5009775, 97.52694676, 99.80769795, 67.77421821, 40.37210044, 91.98327507, 52.83491819])
pt = ConstructPoint(XCoordinate=genes_3, YCoordinate=genes, ZCoordinate=0)
qt = QuadTree(Points=pt, Plane=PlaneXY(0, 0, 0), Square=False, Group=Slider(1, range=0..10))  # -> Quads, Points
runion = RegionUnion(Curves=qt.Quads)
fillet = Fillet(Curve=runion, Radius=Slider(2.5, range=0..10))
lng = ListLength(List=fillet)
split = SplitList(List=genes_2, Index=lng)  # -> ListA, ListB
Z = UnitZ(Factor=split.ListA)
extr = Extrude(Base=fillet, Direction=Z)
cap = CapHoles(Brep=extr)
smooth = SettingsQuality()
mesh = MeshBrep(Brep=cap, Settings=smooth)
lng_2 = ListLength(List=mesh)
random = Random(Range=Domain(0, 1), Number=lng_2, Seed=2)
random_2 = Random(Range=Domain(0, 1), Number=lng_2, Seed=3)
random_3 = Random(Range=Domain(0, 1), Number=lng_2, Seed=4)
frgb = ColourRGBF(Alpha=1, Red=random, Green=random_2, Blue=random_3)
mcol = MeshColours(Mesh=graft(mesh), Colours=graft(frgb))
preview = CustomPreview(Geometry=cap, Shader=frgb)
volume = Volume(Geometry=mcol)  # -> flatten(Volume), Centroid
ma = MassAddition(Input=volume.Volume)  # -> Result, PartialResults
biomorpher = Biomorpher(Genome=[genes_3, genes, genes_2], Geometry=mcol, Performance=ma.Result)  # -> Clusters, History, Historic, Clusters_2
