# Grasshopper definition UntangleThread.gh (Grasshopper 1.0.7)
# plug-ins: Biomorpher

# A simple thread that can evolved.
# Try untangling it, or creating a curve that has interest.
# Double click on the biomorpher component to begin.
genes = GenePool(
    Decimals=2,
    Maximum=100,
    Minimum=-100,
    Value=[-33.91544745, 93.81840055, -28.20915763, -23.87192972, 82.99550879, -96.05858259, 4.785240992, 63.63838371, 42.84160105, -8.521399704])
genes_2 = GenePool(
    Decimals=2,
    Maximum=100,
    Minimum=-100,
    Value=[1.215995881, -0.8331044885, -61.20545704, 73.27750672, -40.34652319, -6.329849987, 80.64470092, 77.54811546, -55.58910797, -52.13247541])
genes_3 = GenePool(
    Decimals=2,
    Maximum=100,
    Minimum=0,
    Value=[70.91266877, 49.11981236, 81.60506652, 39.44157541, 9.234239144, 47.08907944, 76.45055945, 65.72516025, 62.66165654, 14.27562287])
pt = ConstructPoint(XCoordinate=genes, YCoordinate=genes_2, ZCoordinate=genes_3)
intcrv = Interpolate(Vertices=pt, Degree=3, Periodic=True, KnotStyle=1)  # -> Curve, Length, Domain
divide = DivideCurve(Curve=intcrv.Curve, Count=Slider(100, range=0..100), Kinks=False)  # -> Points, Tangents, Parameters
curvature = Curvature(Curve=intcrv.Curve, Parameter=divide.Parameters)  # -> P, K, C
vdisex = VectorDisplayEx(Point=curvature.P, Vector=expr("x*100", curvature.K), Colour=RGB(0, 0, 0), Width=2)

# ---- group: Variance of curvature
vlen = VectorLength(Vector=curvature.K)
cluster = Cluster(num=vlen)

# ----
multiplication = Multiplication(A=cluster, B=Slider(1000, range=0..1000))
biomorpher = Biomorpher(Genome=[genes, genes_2, genes_3], Geometry=intcrv.Curve, Performs=[intcrv.Length, multiplication])

# ==== cluster Cluster
num = ClusterInput()
num_2 = Number(num)
avr = Average(Input=num_2)
subtraction = Subtraction(A=avr, B=num_2)
lng = ListLength(List=num_2)
sqr = Square(Value=subtraction)
ma = MassAddition(Input=sqr)  # -> Result, PartialResults
division = Division(A=ma.Result, B=lng)
R = ClusterOutput(division)
